# Grasshopper definition Al Bahar-Panel 02.gh (Grasshopper 1.0.7)

# ----
# Base Triangle
number_slider = Slider(3, range=0..10)
xy_plane = XYPlane(Origin=Point(0, 0, 0))
polygon = Polygon(Plane=xy_plane, Radius=Slider(10, range=0..10), Segments=number_slider, FilletRadius=Slider(0, range=0..100))  # -> Polygon, Length

curve = Curve(polygon.Polygon)
explode = Explode(Curve=curve, Recursive=True)  # -> Segments, Vertices
polygon_center = PolygonCenter(Polyline=curve)  # -> CenterV, CenterE, CenterA
point_on_curve = PointOnCurve(explode.Segments, parameter=0.5)
line = Line(StartPoint=polygon_center.CenterV, EndPoint=point_on_curve)
list_item = ListItem(List=point_on_curve, Index=0, Wrap=True)  # -> Item, Item1, Item2
list_item_2 = ListItem(List=explode.Vertices, Index=0, Wrap=True)  # -> Item, Item1, Item2
line_2 = Line(StartPoint=polygon_center.CenterV, EndPoint=list_item.Item)
length = Length(Curve=flatten(line))
line_3 = Line(StartPoint=polygon_center.CenterV, EndPoint=list_item_2.Item)
bounds = Bounds(Numbers=length)
deconstruct_domain = DeconstructDomain(Domain=bounds)  # -> Start, End
multiplication = Multiplication(A=deconstruct_domain.End, B=Slider(0.81, range=0..1))
unit_z = UnitZ(Factor=multiplication)
move = Move(Geometry=polygon_center.CenterV, Motion=unit_z)  # -> Geometry, Transform
point = Point(polygon_center.CenterV)
line_4 = Line(StartPoint=polygon_center.CenterV, EndPoint=move.Geometry)
length_2 = Length(Curve=line_2)
plane_3pt = Plane3Pt(PointA=move.Geometry, PointB=point, PointC=list_item.Item)
length_3 = Length(Curve=line_3)
plane_3pt_2 = Plane3Pt(PointA=move.Geometry, PointB=point, PointC=list_item_2.Item)
point_2 = Point(move.Geometry)
circle = Circle(Plane=plane_3pt, Radius=length_2)
circle_2 = Circle(Plane=plane_3pt_2, Radius=length_3)
line_5 = Line(StartPoint=list_item.Item, EndPoint=list_item_2.Item)
curve_curve = CurveCurve(CurveA=circle, CurveB=line_2)  # -> Points, ParamsA, ParamsB
length_4 = Length(Curve=line_5)
sphere = Sphere(Base=curve_curve.Points, Radius=length_4)
brep_curve = BrepCurve(Brep=sphere, Curve=circle_2)  # -> Curves, Points
closest_point = ClosestPoint(Point=list_item_2.Item, Cloud=brep_curve.Points)  # -> ClosestPoint, CPIndex, Distance
_4point_surface = _4PointSurface(CornerA=polygon_center.CenterV, CornerB=list_item.Item, CornerC=list_item_2.Item)
_4point_surface_2 = _4PointSurface(CornerA=point_2, CornerB=curve_curve.Points, CornerC=closest_point.ClosestPoint)
brep_edges = BrepEdges(Brep=_4point_surface_2)  # -> Naked, Interior, NonManifold
brep_edges_2 = BrepEdges(Brep=_4point_surface)  # -> Naked, Interior, NonManifold
mirror = Mirror(Geometry=_4point_surface_2, Plane=plane_3pt)  # -> Geometry, Transform
length_5 = Length(Curve=brep_edges.Naked)
length_6 = Length(Curve=brep_edges_2.Naked)
brep = Brep([_4point_surface_2, mirror.Geometry])
panel = Panel(length_5)
panel_2 = Panel(length_6)
polar_array = PolarArray(Geometry=brep, Plane=PlaneXY(0, 0, 0), Count=Slider(3, range=0..10), Angle=6.283185307)  # -> Geometry, Transform
