# Grasshopper definition Case Study - EFFEKT Tower.gh (Grasshopper 1.0.8)

number_slider = Slider(73, range=0..100)
series = Series(Start=0, Step=1, Count=number_slider)
series_2 = Series(Start=0, Step=1, Count=number_slider)
number_slider_2 = Slider(1, range=0..50)
number_slider_3 = Slider(50, range=0..50)
sine = Sine(Value=series)
sine_2 = Sine(Value=series_2)
cosine = Cosine(Value=series)
cosine_2 = Cosine(Value=series_2)
multiplication = Multiplication(A=number_slider_2, B=sine)
multiplication_2 = Multiplication(A=number_slider_3, B=sine_2)
multiplication_3 = Multiplication(A=number_slider_2, B=cosine)
multiplication_4 = Multiplication(A=number_slider_3, B=cosine_2)
construct_point = ConstructPoint(XCoordinate=multiplication_3, YCoordinate=multiplication, ZCoordinate=series)
construct_point_2 = ConstructPoint(XCoordinate=multiplication_4, YCoordinate=multiplication_2, ZCoordinate=series_2)
interpolate = Interpolate(Vertices=construct_point, Degree=3, Periodic=False, KnotStyle=1)  # -> Curve, Length, Domain
interpolate_2 = Interpolate(Vertices=construct_point_2, Degree=3, Periodic=False, KnotStyle=1)  # -> Curve, Length, Domain
ruled_surface = RuledSurface(CurveA=interpolate_2.Curve, CurveB=interpolate.Curve)

xy_plane = XYPlane(Origin=Point(0, 0, 0))
circle = Circle(Plane=xy_plane, Radius=Slider(24, range=0..100))
unit_z = UnitZ(Factor=Slider(67, range=0..100))
move = Move(Geometry=circle, Motion=unit_z)  # -> Geometry, Transform
curve = Curve(circle)
curve_2 = Curve(move.Geometry)

number_slider_4 = Slider(19, range=0..100)
number_slider_5 = Slider(6, range=0..25)
divide_curve = DivideCurve(Curve=curve, Count=number_slider_4, Kinks=False)  # -> Points, Tangents, Parameters
divide_curve_2 = DivideCurve(Curve=curve_2, Count=number_slider_4, Kinks=False)  # -> Points, Tangents, Parameters
negative = Negative(Value=number_slider_5)
shift_list = ShiftList(List=divide_curve.Points, Shift=negative, Wrap=True)
shift_list_2 = ShiftList(List=divide_curve.Points, Shift=number_slider_5, Wrap=True)
line = Line(StartPoint=shift_list_2, EndPoint=divide_curve_2.Points)
line_2 = Line(StartPoint=shift_list, EndPoint=divide_curve_2.Points)
curve_3 = Curve(line)
curve_4 = Curve(line_2)
pipe = Pipe(Curve=[curve_4, curve_3, curve, curve_2], Radius=Slider(0.394, range=0..1), Caps=0, FitRail=False)

loft_options = LoftOptions(Closed=Toggle(True), Adjust=False, Rebuild=0, Refit=0, Type=0)
curve_5 = Curve(curve_4)
loft = Loft(Curves=curve_5, Options=loft_options)

unit_z_2 = UnitZ(Factor=Slider(2, range=0..10))
surface = Surface(ruled_surface)
move_2 = Move(Geometry=surface, Motion=unit_z_2)  # -> Geometry, Transform
unit_z_3 = UnitZ(Factor=1)
brep_brep = BrepBrep(BrepA=loft, BrepB=move_2.Geometry)  # -> Curves, Points

brep = Brep(loft)
surface_2 = Surface(ruled_surface)
brep_brep_2 = BrepBrep(BrepA=brep, BrepB=surface_2)  # -> Curves, Points
xy_plane_2 = XYPlane(Origin=Point(0, 0, 0))
negative_2 = Negative(Value=Slider(3, range=0..10))
offset_curve_loose = OffsetCurveLoose(Curve=brep_brep_2.Curves, Distance=negative_2, Plane=xy_plane_2)
ruled_surface_2 = RuledSurface(CurveA=brep_brep_2.Curves, CurveB=offset_curve_loose)

curve_6 = Curve([offset_curve_loose, curve_2, brep_brep_2.Curves])
unit_z_4 = UnitZ(Factor=Slider(2, range=0..10))
number_slider_6 = Slider(0.5, range=0.5..1)
move_3 = Move(Geometry=curve_6, Motion=unit_z_4)  # -> Geometry, Transform
divide_distance = DivideDistance(Curve=curve_6, Distance=number_slider_6)  # -> Points, Tangents, Parameters
divide_distance_2 = DivideDistance(Curve=move_3.Geometry, Distance=number_slider_6)  # -> Points, Tangents, Parameters
line_3 = Line(StartPoint=divide_distance.Points, EndPoint=divide_distance_2.Points)

custom_preview = CustomPreview(Geometry=[line_3, move_3.Geometry, brep_brep.Curves], Material=ColourSwatch(SwatchColor=RGBA(191, 191, 191, 183)))
custom_preview_2 = CustomPreview(Geometry=[curve_2, curve], Material=ColourSwatch(SwatchColor=RGB(255, 255, 255)))
custom_preview_3 = CustomPreview(Geometry=pipe, Material=ColourSwatch(SwatchColor=RGB(0, 0, 0)))
custom_preview_4 = CustomPreview(Geometry=ruled_surface_2, Material=ColourSwatch(SwatchColor=RGBA(0, 0, 0, 183)))
