# Grasshopper definition Case Study - The Very Many.gh (Grasshopper 1.0.8)
# plug-ins: Kangaroo Components, Weaverbird

# ----
# Create Base Geometry
number_slider = Slider(37, range=0..100)
xy_plane = XYPlane(Origin=Point(0, 0, 0))
rectangle = Rectangle(Plane=xy_plane, XSize=Slider(17, range=0..100), YSize=number_slider, Radius=0)  # -> Rectangle, Length
populate_2d = Populate2D(Region=rectangle.Rectangle, Count=Slider(10, range=0..100), Seed=Slider(71, range=0..100))
voronoi = Voronoi(Points=populate_2d, BruteForceOverride=False)
trim_with_region = TrimWithRegion(Curve=voronoi, Region=rectangle.Rectangle)  # -> Inside, Outside
curve = Curve(trim_with_region.Inside)

panel = Panel("USE WITH CAUTION!")
custom_preview = CustomPreview(Geometry=curve, Material=ColourSwatch(SwatchColor=RGB(255, 255, 255)))

# ----
# Remove Duplicate Lines
# Right click on the node to set this to "Leave One"
curve_2 = Curve(curve)
explode = Explode(Curve=curve_2, Recursive=True)  # -> Segments, Vertices
flatten_tree = FlattenTree(Tree=explode.Segments, Path="{0}")
curve_middle = CurveMiddle(Curve=flatten_tree)
cull_duplicates = CullDuplicates(Points=curve_middle, Tolerance=0.1, CullMode=1)  # -> Points, Indices, Valence
list_item = ListItem(List=flatten_tree, Index=cull_duplicates.Indices, Wrap=True)
curve_3 = Curve(list_item)

number_slider_2 = Slider(2, range=0..10)
curve_4 = Curve(curve_3)
negative = Negative(Value=number_slider_2)
entwine = Entwine(Branch00=number_slider_2, Branch01=negative, FlattenInputs=True)
offset_curve = OffsetCurve(Curve=curve_4, Distance=entwine, Corners=1)
simplify_tree = SimplifyTree(Tree=offset_curve, Front=False)
shift_paths = ShiftPaths(Data=simplify_tree, Offset=Slider(1, range=0..1))
curve_5 = Curve(shift_paths)

custom_preview_2 = CustomPreview(Geometry=curve_5, Material=ColourSwatch(SwatchColor=RGB(120, 120, 120)))
param_viewer = ParamViewer(curve_5)

# ----
# Build Closed Outline from Edge Curves
curve_6 = Curve(curve_5)
list_item_2 = ListItem(List=curve_6, Index=0, Wrap=True)  # -> Item, Item1
flip_curve = FlipCurve(Curve=list_item_2.Item1)  # -> Curve, Flag
merge = Merge(Data1=list_item_2.Item, Data2=flip_curve.Curve)
connect_curves = ConnectCurves(Curves=merge, Continuity=Slider(0, range=0..100), Close=True, Bulge=1)
flatten_tree_2 = FlattenTree(Tree=connect_curves, Path="{0}")
region_union = RegionUnion(Curves=flatten_tree_2)
curve_7 = Curve(region_union)

# ----
# Sort Curves by Edge Length and get "Ends" vs "Edges"
curve_8 = Curve(curve_7)
explode_2 = Explode(Curve=curve_8, Recursive=True)  # -> Segments, Vertices
flatten_tree_3 = FlattenTree(Tree=explode_2.Segments, Path="{0}")
length = Length(Curve=flatten_tree_3)
multiplication = Multiplication(A=number_slider_2, B="2")
expression = Expression(x=length, Expression="Round(x, 4)")
equality = Equality(FirstNumber=expression, SecondNumber=multiplication)  # -> Equality, Inequality
dispatch = Dispatch(List=flatten_tree_3, DispatchPattern=equality.Inequality)  # -> ListA, ListB
end = Curve(dispatch.ListB)
edges = Curve(dispatch.ListA)

curve_9 = Curve(curve_3)
graft_tree = GraftTree(Tree=curve_9, IncludeEmptyLists=True, IncludeNullItems=True)
curve_middle_2 = CurveMiddle(Curve=curve_9)
curve_middle_3 = CurveMiddle(Curve=edges)
dot_display = DotDisplay(Point=curve_middle_2, Colour=ColourSwatch(SwatchColor=RGB(56, 215, 255)), Size=Slider(0.114, range=0..1))
custom_preview_3 = CustomPreview(Geometry=curve_9, Material=ColourSwatch(SwatchColor=RGB(0, 204, 255)))
closest_points = ClosestPoints(Point=curve_middle_2, Cloud=curve_middle_3, Count="2")  # -> ClosestPoint, CPIndex, Distance
custom_preview_4 = CustomPreview(Geometry=edges, Material=ColourSwatch(SwatchColor=RGB(255, 255, 56)))
dot_display_2 = DotDisplay(Point=curve_middle_3, Colour=ColourSwatch(SwatchColor=RGB(255, 255, 56)), Size=Slider(0.091, range=0..1))
list_item_3 = ListItem(List=edges, Index=closest_points.CPIndex, Wrap=True)
insert_items = InsertItems(List=list_item_3, Item=graft_tree, Indices="1", Wrap=True)

# ----
# Create Base Mesh and Refine
number_slider_3 = Slider(3, range=0..10)
curve_10 = Curve(insert_items)
loft_options = LoftOptions(Closed=False, Adjust=Toggle(True), Rebuild=0, Refit=0, Type=number_slider_3)
loft = Loft(Curves=curve_10, Options=loft_options)
flatten_tree_4 = FlattenTree(Tree=loft, Path="{0}")
simple_mesh = SimpleMesh(Brep=flatten_tree_4)
mesh_join = MeshJoin(Meshes=simple_mesh)
weld_mesh = WeldMesh(Mesh=mesh_join, Angle=3.141592654)
refine = Refine(Mesh=weld_mesh, Level=Slider(3, range=0..10))

mesh_edges = MeshEdges(Mesh=refine)  # -> NakedEdges, InteriorEdges, NonManifoldEdges

mesh = Mesh(refine)
nakedvertices = NakedVertices(Mesh=mesh)  # -> ClothedIndex, NakedIndex, ClothedPts, NakedPts
point = Point(nakedvertices.NakedPts)
pull_point = PullPoint(Point=point, Geometry=end, ClosestOnly=True)  # -> ClosestPoint, Distance, Index
expression_2 = Expression(x=pull_point.Distance, Expression="Round(x, 4)")
mesh_edges_2 = MeshEdges(Mesh=mesh)  # -> NakedEdges, InteriorEdges, NonManifoldEdges
equality_2 = Equality(FirstNumber=expression_2, SecondNumber="0")  # -> Equality, Inequality
merge_2 = Merge(Data1=mesh_edges_2.NakedEdges, Data2=mesh_edges_2.InteriorEdges)
cull_pattern = CullPattern(List=point, CullPattern=equality_2.Equality)
length_line = LengthLine(Line=merge_2, Length=Slider(0.333, range=0..1), Strength=Slider(0.15, range=0..1))
edgelengths = EdgeLengths(Mesh=mesh, LengthFactor=1, Strength=1)
show = Show(G=mesh)
vertexloads = VertexLoads(Mesh=mesh, Strength=Slider(0.01, range=-0.1..0.1))
anchor = Anchor(Point=cull_pattern, Strength=10000)
entwine_2 = Entwine(Branch00=show, Branch01=anchor, Branch02=vertexloads, Branch03=edgelengths, Branch04=length_line, FlattenInputs=True)
bouncysolver = BouncySolver(GoalObjects=entwine_2, Reset=Button(), Threshold=1e-15, Tolerance=0.0001, Damping=0.99, Iterations=10, On=True)  # -> I, V, O

list_item_4 = ListItem(List=bouncysolver.O, Index=0, Wrap=True)
mesh_2 = Mesh(list_item_4)
mesh_edges_3 = MeshEdges(Mesh=mesh_2)  # -> NakedEdges, InteriorEdges, NonManifoldEdges

meshdirection = MeshDirection(Mesh=mesh_2)
meshturn = MeshTurn(Mesh=meshdirection)
stripper = Stripper(Mesh=meshturn)

# ----
# Sort Mesh Faces Along Strips
mesh_3 = Mesh(stripper)
face_boundaries = FaceBoundaries(Mesh=mesh_3)
explode_3 = Explode(Curve=face_boundaries, Recursive=True)  # -> Segments, Vertices
panel_2 = Panel("""1
3""")
polygon_center = PolygonCenter(Polyline=face_boundaries)  # -> CenterV, CenterE, CenterA
list_item_5 = ListItem(List=explode_3.Segments, Index=panel_2, Wrap=True)
trim_tree = TrimTree(Tree=list_item_5, Depth=1)
join_curves = JoinCurves(Curves=trim_tree, Preserve=False)
list_item_6 = ListItem(List=join_curves, Index=0, Wrap=True)
sort_along_curve = SortAlongCurve(Points=polygon_center.CenterV, Curve=list_item_6)  # -> Points, Indices
list_item_7 = ListItem(List=face_boundaries, Index=sort_along_curve.Indices, Wrap=True)

mesh_edges_4 = MeshEdges(Mesh=stripper)  # -> NakedEdges, InteriorEdges, NonManifoldEdges

list_length = ListLength(List=mesh_3)
colour_wheel = ColourWheel(
    list_length,
    ColourGrips_Style=31,
    ColourGrips_Grip=[0, 2.094395102, 4.188790205, 3.141592654],
    ColourGrips_Lum=[0.1, 0.5],
    ColourGrips_Range=[0.2617993878, 0.2617993878, 0.2617993878, 0.2617993878],
    ColourGrips_Sat=[0.2, 0.6])
unify_mesh = UnifyMesh(Mesh=mesh_3)  # -> Result, Count
custom_preview_5 = CustomPreview(Geometry=unify_mesh.Result, Material=colour_wheel)

polygon_center_2 = PolygonCenter(Polyline=list_item_7)  # -> CenterV, CenterE, CenterA
point_list = PointList(Points=polygon_center_2.CenterV)

# ----
# Partition Strips into smaller sections
number_slider_4 = Slider(33, range=0..100)  # disabled
number_slider_5 = Slider(4, range=0..10)  # disabled
number_slider_6 = Slider(12, range=0..100)  # disabled
tree_statistics = TreeStatistics(Tree=list_item_7)  # -> Paths, Length, Count; disabled
multiplication_2 = Multiplication(A=tree_statistics.Count, B=number_slider_5)  # disabled
panel_3 = Panel("4 to 10")  # disabled
random = Random(Range=panel_3, Number=tree_statistics.Count, Seed=number_slider_4)  # disabled
duplicate_data = DuplicateData(Data=number_slider_6, Number=multiplication_2, Order=True)  # disabled
partition_list = PartitionList(List=duplicate_data, Size=number_slider_5)  # disabled
graft_tree_2 = GraftTree(Tree=random, IncludeEmptyLists=True, IncludeNullItems=True)  # disabled
merge_3 = Merge(Data1=graft_tree_2, Data3=partition_list)  # disabled
partition_list_2 = PartitionList(List=list_item_7, Size=merge_3)  # disabled

simple_mesh_2 = SimpleMesh(Brep=partition_list_2)  # disabled
combine_clean = CombineClean(Meshes=simple_mesh_2)  # disabled

# ----
# Create Gaps at Edges For Fabrication
curve_11 = Curve(partition_list_2)  # disabled
number_slider_7 = Slider(0.002, range=0..0.01)  # disabled
explode_4 = Explode(Curve=curve_11, Recursive=True)  # -> Segments, Vertices; disabled
panel_4 = Panel("""0
2""")  # disabled
negative_2 = Negative(Value=number_slider_7)  # disabled
list_item_8 = ListItem(List=explode_4.Segments, Index=panel_4, Wrap=True)  # disabled
extend_curve = ExtendCurve(Curve=list_item_8, Type=0, Start=negative_2, End=negative_2)  # disabled
end_points = EndPoints(Curve=extend_curve)  # -> Start, End; disabled
graft_tree_3 = GraftTree(Tree=end_points.Start, IncludeEmptyLists=True, IncludeNullItems=True)  # disabled
graft_tree_4 = GraftTree(Tree=end_points.End, IncludeEmptyLists=True, IncludeNullItems=True)  # disabled
merge_4 = Merge(Data1=graft_tree_3, Data2=graft_tree_4)  # disabled
trim_tree_2 = TrimTree(Tree=merge_4, Depth=1)  # disabled
number_slider_8 = Slider(1, range=0..1)  # disabled
construct_mesh = ConstructMesh(Vertices=trim_tree_2, Faces={A=0, B=1, C=2, D=3})  # disabled
trim_tree_3 = TrimTree(Tree=construct_mesh, Depth=number_slider_8)  # disabled
mesh_join_2 = MeshJoin(Meshes=trim_tree_3)  # disabled
weld_mesh_2 = WeldMesh(Mesh=mesh_join_2, Angle=3.141592654)  # disabled

number_slider_9 = Slider(0.006, range=0..0.01)  # disabled
mesh_4 = Mesh(weld_mesh_2)  # disabled
weaverbird_s_offset_mesh = WeaverbirdsOffsetMesh(MeshCurves=mesh_4, Distance=number_slider_9, OffsetType=0)  # disabled
colour_swatch = ColourSwatch(SwatchColor=RGB(255, 255, 255))  # disabled
mesh_5 = Mesh(weld_mesh_2)  # disabled
custom_preview_6 = CustomPreview(Geometry=weaverbird_s_offset_mesh, Material=colour_swatch)  # disabled
number_slider_10 = Slider(1, range=0..1)  # disabled
number_slider_11 = Slider(0, range=0..10)  # disabled
unroller = Unroller(Strip=flatten(mesh_5), Unroll=number_slider_10)  # disabled
number_slider_12 = Slider(61, range=0..100)  # disabled
mesh_edges_5 = MeshEdges(Mesh=unroller)  # -> NakedEdges, InteriorEdges, NonManifoldEdges; disabled
planarityanalysis = PlanarityAnalysis(Mesh=unroller, Max=0.01)  # -> M, P; disabled
join_curves_2 = JoinCurves(Curves=mesh_edges_5.NakedEdges, Preserve=False)  # disabled
list_item_9 = ListItem(List=flatten(join_curves_2), Index=number_slider_12, Wrap=True)  # disabled
boundary_surfaces = BoundarySurfaces(Edges=join_curves_2)  # disabled
is_planar = IsPlanar(Surface=join_curves_2, Interior=True)  # -> Planar, Plane; disabled
xy_plane_2 = XYPlane(Origin=Point(0, 0, 0))  # disabled
flatten_tree_5 = FlattenTree(Tree=is_planar.Plane, Path="{0}")  # disabled
orient = Orient(Geometry=graft(unroller), Source=is_planar.Plane, Target=xy_plane_2)  # -> Geometry, Transform; disabled
