# Grasshopper definition Class Questions - 260324.gh (Grasshopper 1.0.8)

number_slider = Slider(12, range=0..100)
# Rotating Panels
surface = Surface(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)
# Frames!
# Also see: horizontal frame
curve = Curve(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)
number_of_points = Slider(20, range=0..100)
# Graph Mapper Scales
curve_2 = Curve(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)
divide_domain² = DivideDomain²(Domain=surface, UCount=number_slider, VCount=number_slider)
isotrim = Isotrim(Surface=surface, Domain=divide_domain²)
divide_curve = DivideCurve(Curve=curve_2, Count=number_of_points, Kinks=False)  # -> Points, Tangents, Parameters
divide_distance = DivideDistance(Curve=curve, Distance=Slider(12, range=0..100))  # -> Points, Tangents, Parameters
construct_domain = ConstructDomain(DomainStart="0", DomainEnd="1")
bounds = Bounds(Numbers=divide_curve.Parameters)
area = Area(Geometry=isotrim)  # -> Area, Centroid
brep_edges = BrepEdges(Brep=isotrim)  # -> Naked, Interior, NonManifold
# Frames equally spaced by number
perp_frames = PerpFrames(Curve=curve, Count=Slider(12, range=0..100), Align=True)  # -> Frames, Parameters
# Frames spaced by distance
perp_frame = PerpFrame(Curve=curve, Parameter=divide_distance.Parameters)
min_height = Slider(12, range=0..100)
max_height = Slider(100, range=0..100)
# Click Me and Move point in
# Rhino with the Gumball
surface_closest_point = SurfaceClosestPoint(Point=area.Centroid, Surface=isotrim)  # -> Point, UVPoint, Distance
remap_numbers = RemapNumbers(Value=divide_curve.Parameters, Source=bounds, Target=construct_domain)  # -> Mapped, Clipped
evaluate_surface = EvaluateSurface(Surface=isotrim, Point=surface_closest_point.UVPoint)  # -> Point, Normal, UDirection, VDirection, Frame
graph_mapper = GraphMapper(
    remap_numbers.Mapped,
    x0=0,
    x1=1,
    y0=0,
    y1=1,
    amplitude=0.3,
    container_name="Perlin",
    decay=0.3,
    frequency=0.1,
    x_offset=0.5,
    y_offset=0.5)
construct_domain_2 = ConstructDomain(DomainStart=min_height, DomainEnd=max_height)
point = Point(Point(1307.517863, -346.0039583, 208.3415212))
line = Line(StartPoint=point, EndPoint=evaluate_surface.Point)
remap_numbers_2 = RemapNumbers(Value=graph_mapper, Source=construct_domain, Target=construct_domain_2)  # -> Mapped, Clipped

custom_preview = CustomPreview(Geometry=line, Material=ColourSwatch(SwatchColor=RGBA(186, 186, 186, 137)))

point_2 = Point(divide_curve.Points)
unit_z = UnitZ(Factor=remap_numbers_2.Mapped)
unit_x = UnitX(Factor=remap_numbers_2.Mapped)
unit_x_2 = UnitX(Factor=remap_numbers_2.Mapped)
negative = Negative(Value=unit_x_2)
perp_frame_2 = PerpFrame(Curve=line, Parameter=Slider(1, range=0..1))
move = Move(Geometry=point_2, Motion=unit_z)  # -> Geometry, Transform
move_2 = Move(Geometry=point_2, Motion=unit_x)  # -> Geometry, Transform
move_3 = Move(Geometry=point_2, Motion=negative)  # -> Geometry, Transform
orient = Orient(Geometry=isotrim, Source=evaluate_surface.Frame, Target=perp_frame_2)  # -> Geometry, Transform
line_2 = Line(StartPoint=point_2, EndPoint=move.Geometry)
line_3 = Line(StartPoint=move_2.Geometry, EndPoint=move_3.Geometry)
