# Grasshopper definition GIS - Grasshopper - Herron - Class Example 01.gh (Grasshopper 1.0.8)
# plug-ins: Heron, Bifocals

curve = Curve(<curve referenced from the Rhino model>)
curve_2 = Curve(<curve referenced from the Rhino model>)
file_path = FilePath("C:\Users\cssch\Downloads\map.osm")
file_path_2 = FilePath("C:\Users\cssch\Downloads\map.osm")
curve_3 = Curve(<curve referenced from the Rhino model>)
set_earthanchorpoint = SetEarthAnchorPoint(SetEAP=Toggle(True), Latitude="45.666872", Longitude="-111.0528387")
import_osm = ImportOSM(Boundary=curve, OSMDataLocation=file_path_2, Clipped=True)  # -> Extents, Fields, Values, FeatureGeometry, Buildings
import_osm_2 = ImportOSM(Boundary=curve_3, OSMDataLocation=file_path, FilterFields="highway", Clipped=True)  # -> Extents, Fields, Values, FeatureGeometry, Buildings
import_vector = ImportVector(Boundary=curve_2, FilePath="C:\Users\cssch\Downloads\Parcels\Parcels.shp", ClipIt=True, PointsOnly=False)  # -> DataExtents, Fields, Values, FeatureGeometry
panel = Panel(set_earthanchorpoint)
panel_2 = Panel(import_vector.FeatureGeometry)
mesh_edges = MeshEdges(Mesh=import_vector.FeatureGeometry)  # -> NakedEdges, InteriorEdges, NonManifoldEdges
panel_3 = Panel(import_osm.Fields)
curve_4 = Curve(mesh_edges.NakedEdges)
panel_4 = Panel(import_osm.Values)
