# Grasshopper definition ParametricCanopy.gh (Grasshopper 1.0.7)
# plug-ins: Bifocals, LunchBox

# ----
# Bottom Circle
bottom_radius = Slider(8, range=1..20)
# Parametric Panels
# Create the base logic for the surface, in this case (3) circles of various height and radius which will be lofted together
bottom_height = Slider(0, range=0..100)
construct_point = ConstructPoint(XCoordinate=0, YCoordinate=0, ZCoordinate=bottom_height)
xy_plane = XYPlane(Origin=construct_point)
circle = Circle(Plane=xy_plane, Radius=bottom_radius)

# ----
# Middle Circle
middle_radius = Slider(11, range=1..20)
middle_height = Slider(20, range=0..100)
construct_point_2 = ConstructPoint(XCoordinate=0, YCoordinate=0, ZCoordinate=middle_height)
xy_plane_2 = XYPlane(Origin=construct_point_2)
circle_2 = Circle(Plane=xy_plane_2, Radius=middle_radius)

# ----
# Top Circle
top_radius = Slider(55, range=1..100)
top_height = Slider(43, range=0..100)
construct_point_3 = ConstructPoint(XCoordinate=0, YCoordinate=0, ZCoordinate=top_height)
xy_plane_3 = XYPlane(Origin=construct_point_3)
circle_3 = Circle(Plane=xy_plane_3, Radius=top_radius)

# ---- group: Bottom Curve
# Create a lofted surface from the base geometry, note the merge node to control the list order of the curves
curve = Curve(circle)

# ---- group: Top Curve
curve_2 = Curve(circle_3)

# ---- group: Middle Curve
curve_3 = Curve(circle_2)

# ----
# Create Lofted Surface
merge = Merge(Data1=curve, Data2=curve_3, Data3=curve_2)
loft_options = LoftOptions(Closed=False, Adjust=False, Rebuild=0, Refit=0, Type=0)
loft = Loft(Curves=merge, Options=loft_options)

# ----
# Eliminate Seam
number_slider = Slider(3, range=0..3)
# This uses the reverse surface node from the Lunchbox plugin to eliminate the vertical seam on the surface
surface = Surface(loft)
reverse_surface_direction = ReverseSurfaceDirection(Surface=surface, ReverseOption=number_slider)

# ----
# Divide Surface
number_slider_2 = Slider(46, range=0..100)
# The surface is converted into a mesh for performace reasons down the line
surface_2 = Surface(reverse_surface_direction)
triangle_panels_b = TrianglePanelsB(Surface=surface_2, UDivisions=number_slider_2, VDivisions=Slider(21, range=0..100))

# ----
# The surface is converted into a mesh for performace reasons down the line
# Convert Surface To Mesh
surface_3 = Surface(triangle_panels_b)
discontinuity = Discontinuity(Curve=surface_3, Level=1)  # -> Points, Parameters
mesh_triangle = MeshTriangle(CornerA=0, CornerB=1, CornerC=2)
construct_mesh = ConstructMesh(Vertices=discontinuity.Points, Faces=mesh_triangle)

# ----
# This takes multiple meshes in this case the faces of the surface and joins them into a simgle unified mesh
# Join Mesh & Weld
mesh = Mesh(construct_mesh)
mesh_join = MeshJoin(Meshes=flatten(mesh))
unify_mesh = UnifyMesh(Mesh=mesh_join)  # -> Result, Count

# ----
# Create Pipes
mesh_2 = Mesh(unify_mesh.Result)
mesh_edges = MeshEdges(Mesh=mesh_2)  # -> NakedEdges, InteriorEdges, NonManifoldEdges
pipe = Pipe(Curve=mesh_edges.InteriorEdges, Radius=Slider(0.236, range=0..1), Caps=0)

custom_preview = CustomPreview(Geometry=unify_mesh.Result, Material=ColourSwatch(SwatchColor=RGBA(255, 255, 255, 35)))

custom_preview_2 = CustomPreview(Geometry=pipe, Material=ColourSwatch(SwatchColor=RGB(0, 0, 0)))
