# Grasshopper definition Text Tag - Font.gh (Grasshopper 1.0.8)

# ----
# Text Tag 3d - Custom Font
panel = Panel("SLF-RHN Architect")
boolean_toggle = BooleanToggle(False)
point = Point(Point(28.29413765, 96.71852358, 0))
text_lines = CSharpScript(
    face=panel,
    bold=boolean_toggle,
    italics=boolean_toggle,
    size=Slider(5.02, range=0..10),
    content="Como estas?",
    plane=point)  # -> out, a; inputs face: String, bold: Boolean, italics: Boolean, size: Double, content: String, plane: Plane
# ---------- text_lines: C# ----------
// Grasshopper Script Instance
#region Usings
using System;
using System.Linq;
using System.Collections;
using System.Collections.Generic;
using System.Drawing;

using Rhino;
using Rhino.Geometry;

using Grasshopper;
using Grasshopper.Kernel;
using Grasshopper.Kernel.Data;
using Grasshopper.Kernel.Types;
#endregion

public class Script_Instance : GH_ScriptInstance
{
    #region Notes
    /* 
      Members:
        RhinoDoc RhinoDocument
        GH_Document GrasshopperDocument
        IGH_Component Component
        int Iteration

      Methods (Virtual & overridable):
        Print(string text)
        Print(string format, params object[] args)
        Reflect(object obj)
        Reflect(object obj, string method_name)
    */
    #endregion

    private void RunScript(
		string face,
		bool bold,
		bool italics,
		double size,
		string content,
		Plane plane,
		ref object a)
    {
        // Write your logic here
        if(size == 0)
        size = 1;

            if(!string.IsNullOrEmpty(face) && size > 0 && !string.IsNullOrEmpty(content) &&
            plane.IsValid)
            {

            var te = RhinoDoc.ActiveDoc.Objects.AddText(content, plane, size, face, bold, italics);
            Rhino.DocObjects.TextObject txt = RhinoDoc.ActiveDoc.Objects.Find(te) as Rhino.DocObjects.TextObject;

            if(txt != null)
            {
                var tt = txt.Geometry as Rhino.Geometry.TextEntity;
                a = tt.Explode();
            }

            RhinoDoc.ActiveDoc.Objects.Delete(te, true);
            }
    }
}
# ---------- end text_lines ----------
