# Grasshopper definition twisted weaving.gh (Grasshopper 1.0.8)

# ----
# Single Module - 3D - DoubleTwist  (Weave)
point = Point(Point(49.70984392, -0.08720703507, 0))
polygon = Polygon(Plane=point, Radius=Slider(12, range=0..100), Segments=6, FilletRadius=0)  # -> Polygon, Length

# ----
# We use the exact same script for the single module, however, instead of giving it a single closed polygon, we give it multiple!
point_2 = Point(Point(112.9363026, -0.07647590304, 0))
hexagonal = Hexagonal(Plane=point_2, Size=Slider(12, range=0..100), ExtentX=5, ExtentY=5)  # -> Cells, Points

# ----
# Single Module - 2D - Single Twist
number_slider = Slider(12, range=0..100)
polygon_2 = Polygon(Plane=PlaneXY(0, 0, 0), Radius=number_slider, Segments=6, FilletRadius=0)  # -> Polygon, Length

# ----
# Multiple Module - 3D - DoubleTwist  (Weave)
point_3 = Point(Point(49.70984392, -0.08720703507, 0))
polygon_3 = Polygon(Plane=point_3, Radius=Slider(12, range=0..100), Segments=6, FilletRadius=0)  # -> Polygon, Length

curve = Curve(polygon_2.Polygon)
curve_2 = Curve(polygon.Polygon)
move = Move(Geometry=curve_2, Motion=Vector(0, 0, 10))  # -> Geometry, Transform
curve_3 = Curve(hexagonal.Cells)
move_2 = Move(Geometry=curve_3, Motion=Vector(0, 0, 10))  # -> Geometry, Transform
explode = Explode(Curve=curve, Recursive=True)  # -> Segments, Vertices
explode_2 = Explode(Curve=curve_2, Recursive=True)  # -> Segments, Vertices
explode_3 = Explode(Curve=move.Geometry, Recursive=True)  # -> Segments, Vertices
explode_4 = Explode(Curve=curve_3, Recursive=True)  # -> Segments, Vertices
explode_5 = Explode(Curve=move_2.Geometry, Recursive=True)  # -> Segments, Vertices
line = Line(StartPoint=explode_2.Vertices, EndPoint=explode_3.Vertices)
curve_4 = Curve([move.Geometry, curve_2])
line_2 = Line(StartPoint=explode_4.Vertices, EndPoint=explode_5.Vertices)
shift_list = ShiftList(List=explode.Segments, Shift=Slider(2, range=1..10), Wrap=True)
number_slider_2 = Slider(8, range=0..100)
curve_5 = Curve([move_2.Geometry, curve_3])
number_slider_3 = Slider(2, range=1..10)
number_slider_4 = Slider(2, range=1..10)
divide_curve = DivideCurve(Curve=explode.Segments, Count=number_slider_2, Kinks=False)  # -> Points, Tangents, Parameters
divide_curve_2 = DivideCurve(Curve=shift_list, Count=number_slider_2, Kinks=False)  # -> Points, Tangents, Parameters
number_slider_5 = Slider(8, range=0..100)
number_slider_6 = Slider(8, range=0..100)
negative = Negative(Value=number_slider_3)
negative_2 = Negative(Value=number_slider_4)
line_3 = Line(StartPoint=divide_curve.Points, EndPoint=divide_curve_2.Points)
shift_list_2 = ShiftList(List=explode_3.Segments, Shift=negative, Wrap=True)
shift_list_3 = ShiftList(List=explode_3.Segments, Shift=number_slider_3, Wrap=True)
shift_list_4 = ShiftList(List=explode_5.Segments, Shift=negative_2, Wrap=True)
shift_list_5 = ShiftList(List=explode_5.Segments, Shift=number_slider_4, Wrap=True)
curve_6 = Curve(curve_4)

# ----
# Only use the frames to import into Revit
# at first, We can bring in the strings later.
# 1 million + parts will be dificult for most
# computers to process.
# 
# Otherwise, lets focus on bringing in just 1
# of the modules, frames, strings, and all.
number_slider_7 = Slider(0.4, range=0..1)
curve_7 = Curve(line)
pipe = Pipe(Curve=[curve_7, curve_6], Radius=number_slider_7, Caps=0, FitRail=False)

divide_curve_3 = DivideCurve(Curve=explode_2.Segments, Count=number_slider_5, Kinks=False)  # -> Points, Tangents, Parameters
divide_curve_4 = DivideCurve(Curve=shift_list_2, Count=number_slider_5, Kinks=False)  # -> Points, Tangents, Parameters
divide_curve_5 = DivideCurve(Curve=shift_list_3, Count=number_slider_5, Kinks=False)  # -> Points, Tangents, Parameters
curve_8 = Curve(curve_5)

curve_9 = Curve(line_2)
pipe_2 = Pipe(Curve=[curve_9, curve_8], Radius=Slider(0.4, range=0..1), Caps=0, FitRail=False)

divide_curve_6 = DivideCurve(Curve=explode_4.Segments, Count=number_slider_6, Kinks=False)  # -> Points, Tangents, Parameters
divide_curve_7 = DivideCurve(Curve=shift_list_4, Count=number_slider_6, Kinks=False)  # -> Points, Tangents, Parameters
divide_curve_8 = DivideCurve(Curve=shift_list_5, Count=number_slider_6, Kinks=False)  # -> Points, Tangents, Parameters
line_4 = Line(StartPoint=divide_curve_3.Points, EndPoint=divide_curve_5.Points)
line_5 = Line(StartPoint=divide_curve_3.Points, EndPoint=divide_curve_4.Points)
line_6 = Line(StartPoint=divide_curve_6.Points, EndPoint=divide_curve_8.Points)
line_7 = Line(StartPoint=divide_curve_6.Points, EndPoint=divide_curve_7.Points)
custom_preview = CustomPreview(Geometry=line_5, Material=ColourSwatch(SwatchColor=RGB(0, 0, 0)))
custom_preview_2 = CustomPreview(Geometry=line_4, Material=ColourSwatch(SwatchColor=RGB(255, 255, 255)))
custom_preview_3 = CustomPreview(Geometry=line_7, Material=ColourSwatch(SwatchColor=RGB(0, 0, 0)))
custom_preview_4 = CustomPreview(Geometry=line_6, Material=ColourSwatch(SwatchColor=RGB(255, 255, 255)))
